# Grasshopper definition GothineExport.gh (Grasshopper 0.9.14)

pt = Point(graft([<point referenced from the Rhino model> x2]))
pt_2 = PointXYZ(XComponent=0, YComponent=0, ZComponent=Slider(175.013, range=0..201), System=PlaneXY(0, 0, 0))
pt_3 = PointXYZ(XComponent=0, YComponent=0, ZComponent=Slider(33.327, range=0..101), System=PlaneXY(0, 0, 0))
pt_4 = PointXYZ(XComponent=0, YComponent=0, ZComponent=Slider(220.278, range=0..601), System=PlaneXY(0, 0, 0))
move = Move(Geometry=pt, Motion=pt_2)  # -> Geometry, Transform
move_2 = Move(Geometry=pt, Motion=pt_3)  # -> Geometry, Transform
move_3 = Move(Geometry=pt, Motion=pt_4)  # -> Geometry, Transform
polygon = Polygon(Plane=move_3.Geometry, Radius=Slider(210.947, range=0..501), Segments=Slider(21, range=3..24), FilletRadius=0)  # -> Polygon, Length
polygon_2 = Polygon(Plane=move_2.Geometry, Radius=Slider(32.184, range=0..501), Segments=Slider(4, range=3..24), FilletRadius=0)  # -> Polygon, Length
polygon_3 = Polygon(Plane=move.Geometry, Radius=Slider(119.866, range=0..501), Segments=Slider(21, range=3..24), FilletRadius=0)  # -> Polygon, Length
polygon_4 = Polygon(Plane=pt, Radius=Slider(21.492, range=0..501), Segments=Slider(4, range=3..24), FilletRadius=0)  # -> Polygon, Length
loft = Loft(
    Curves=[polygon_4.Polygon, polygon_2.Polygon, polygon_3.Polygon, polygon.Polygon],
    Options={Adjust=False, Closed=False, Rebuild=10, Refit=0.01, LoftType=0, LoftEnds=0, LoftSimp=0})
edges = BrepEdges(Brep=loft)  # -> Naked, Interior, NonManifold
yz = YZPlane(Origin=Point(0, 0, 0))
expression = Expression(Expression="rad(-115)")
crv = Curve(edges.Interior)
move_4 = Move(Geometry=yz, Motion=pt)  # -> Geometry, Transform
rotate = Rotate(Geometry=crv, Angle=expression, Plane=move_4.Geometry)  # -> Geometry, Transform
divide = DivideCurve(Curve=rotate.Geometry, Count=Slider(20, range=0..31), Kinks=False)  # -> Points, Tangents, Parameters
line = LineSDL(Start=divide.Points, Direction=divide.Tangents, Length=Slider(0.346, range=0..4))  # -> simplify(Line)
crv_2 = Curve(simplify(line))
end = EndPoints(Curve=crv_2)  # -> Start, End
subtraction = Subtraction(A=end.End, B=end.Start)
string = String(";")
concat = Concatenate(A=end.Start, B=string)
concat_2 = Concatenate(A=concat, B=subtraction)
rep = ReplaceString(String=concat_2, Find="{")
rep_2 = ReplaceString(String=rep, Find=" ")
rep_3 = ReplaceString(String=rep_2, Find="}")
string_2 = String(";")
concat_3 = Concatenate(A=rep_3, B=string_2)
join = StringJoin(Strings=simplify(rep_3), Join="/")  # -> simplify(Result)
concat_4 = Concatenate(A=join, B="/")
pshift = ShiftPaths(Data=concat_4, Offset=-1)
join_2 = StringJoin(Strings=pshift)
rep_4 = ReplaceString(String=join_2, Find=" ")
panel = Panel(rep_4)
