# Grasshopper definition RhinoImport.gh (Grasshopper 0.9.14)

panel = Panel("Import Trails")

# ---- group: DataPath Trails
path = FilePath("D:\Teaching_Innsbruck\2012WS_Diploma\Gothine_03\boids_03\data\fromProcessing\ExportTrails2012_11_12_21_18180.txt")

# ----
file = ReadFile(Path=path, Lines=True)
string = String(" ")
split = StringSplit(String=file, Separators=string)
item = ListItem(List=split, Index=0, Wrap=False)
string_2 = String(";")
split_2 = StringSplit(String=graft(item), Separators=string_2)
lng = ListLength(List=split_2)
cull_i = CullIndex(List=split_2, Indices=expr("i-1", lng), Wrap=False)
lng_2 = ListLength(List=cull_i)
item_2 = ListItem(List=cull_i, Index=expr("i-1", lng_2), Wrap=False)
slider = Slider(1, range=0..1)
pline_trail = PolyLine(Vertices=simplify(cull_i), Closed=False)
pt_boid = Point(item_2)
simplify = SimplifyCurve(Curve=pline_trail, Tolerance=slider, AngleTolerance=slider)  # -> Curve, Simplified
